vi "ColumnwiseFFT.gvi"   [LabVIEW Communications System Design Suite 2.0.1]
inputs:
  "X": c128[][]
  "Inverse?": bool
  "error in": error
outputs:
  "Error": error
  "Xf": c128[][]
uses:
  NI::Analysis::Transforms::Complex FFT.gvi
  NI::Analysis::Transforms::Inverse Complex FFT.gvi
diagram:
  Transpose 2D Array(2D array=$X) -> (transposed array=w1)
  case ($"Inverse?") {
    frame False, Default {
      for {
        w4 = each element of w1
        call "Complex FFT.gvi"(x=w4, error in=$"error in") -> (FFT{x}=w5, error out=w3)
        append w5 to w2
      }
    }
    frame True {
      for {
        w6 = each element of w1
        call "Inverse Complex FFT.gvi"(FFT{x}=w6, error in=$"error in") -> (x=w7, error out=w3)
        append w7 to w2
      }
    }
  }
  Transpose 2D Array(2D array=w2) -> (transposed array=w8)
  $Xf <- w8
  $Error <- w3
