vi "Gen_rand_mat.gvi"   [LabVIEW Communications System Design Suite 2.0.1]
inputs:
  "K": i32
  "M": i32
outputs:
  "X": c128[][]
diagram:
  for (N = $K) {
    for (N = $M) {
      Random Number() -> (number (0 to 1)=w3)
      Random Number() -> (number (0 to 1)=w4)
      Real And Imaginary To Complex(x=w3, y=w4) -> w5
      append w5 to w2
    }
    append w2 to w1
  }
  $X <- w1
