vi "NMSE.gvi"   [LabVIEW Communications System Design Suite 2.0.1]
inputs:
  "x1": c128[]
  "x2": c128[]
outputs:
  "NMSE": f64
diagram:
  Subtract(x=$x1, y=$x2) -> w1
  Absolute Value(x=w1) -> w2
  Array Size(array=w2) -> (size(s)=w3)
  Add Array Elements(numeric array=w2) -> (sum=w4)
  Divide(x=w4, y=w3) -> w5
  $NMSE <- w5
