vi "NMSE_2D.gvi"   [LabVIEW Communications System Design Suite 2.0.1]
inputs:
  "X1": c128[][]
  "X2": c128[][]
outputs:
  "NMSE": f64
diagram:
  Array Size(array=$X2) -> (size(s)=w1)
  Array Index(array=w1) -> (out0[_]=w2, out1[_]=w3)
  Multiply(w2, w3) -> w4
  Reshape Array(inArray=$X1, size=w4) -> w5
  Reshape Array(inArray=$X2, size=w4) -> w6
  call "NMSE.gvi"(x1=w5, x2=w6) -> (NMSE=w7)
  $NMSE <- w7
