vi "Test_V.gvi"   [LabVIEW Communications System Design Suite 2.0.1]
panel controls:
  "P": i32 = 8
  "Q": i32 = 16
panel indicators:
  "x": c128[]
  "NMSE": f64
diagram:
  Multiply($P, $Q) -> w1
  call "Gen_rand_mat.gvi"(K=$P, M=$Q) -> (X=w2)
  Reshape Array(inArray=w2, size=w1) -> w3
  call "V.gvi"(P=$P, Q=$Q, x=w3) -> (Vx=w4)
  call "iV.gvi"(Vx=w4) -> (x=w5)
  call "NMSE.gvi"(x1=w3, x2=w5) -> (NMSE=w6)
  $NMSE <- w6
  $x <- w5
