vi "Test_Z.gvi"   [LabVIEW Communications System Design Suite 2.0.1]
panel controls:
  "P": i32 = 8
  "Q": i32 = 16
panel indicators:
  "x": c128[]
  "NMSE": f64
diagram:
  call "Gen_rand_mat.gvi"(K=$P, M=$Q) -> (X=w1)
  Multiply($P, $Q) -> w2
  Reshape Array(inArray=w1, size=w2) -> w3
  call "Z.gvi"(x=w3, K=$P, M=$Q) -> (Z_MK=w4)
  call "iZ.gvi"(Z_MK=w4) -> (x=w5)
  call "NMSE.gvi"(x1=w3, x2=w5) -> (NMSE=w6)
  $NMSE <- w6
  $x <- w5
