vi "Test_Zbar.gvi"   [LabVIEW Communications System Design Suite 2.0.1]
panel controls:
  "P": i32 = 8
  "Q": i32 = 16
panel indicators:
  "NMSE": f64
diagram:
  call "Gen_rand_mat.gvi"(K=$P, M=$Q) -> (X=w1)
  Multiply($P, $Q) -> w2
  Reshape Array(inArray=w1, size=w2) -> w3
  call "Zbar.gvi"(x=w3, K=$P, M=$Q) -> (Z_KM=w4)
  call "iZbar.gvi"(Z_KM=w4) -> (x=w5)
  call "NMSE.gvi"(x1=w3, x2=w5) -> (NMSE=w6)
  $NMSE <- w6
