vi "Z.gvi"   [LabVIEW Communications System Design Suite 2.0.1]
inputs:
  "x": c128[]
  "K": i32
  "M": i32 = 1
  "error in": error
outputs:
  "error out": error
  "Z_MK": c128[][]
diagram:
  # function Z_QP = Z(x, Q,P)
  # % Zak transform TD
  # Z_QP = fft(V(x, Q,P));
  # end
  call "V.gvi"(P=$M, Q=$K, x=$x) -> (Vx=w1)
  call "ColumnwiseFFT.gvi"(X=w1, Inverse?=FALSE, error in=$"error in") -> (Error=w2, Xf=w3)
  $Z_MK <- w3
  $"error out" <- w2
