vi "Zbar.gvi"   [LabVIEW Communications System Design Suite 2.0.1]
inputs:
  "x": c128[]
  "K": i32
  "M": i32 = 1
  "error in": error
outputs:
  "Z_KM": c128[][]
  "error out": error
diagram:
  # function Zbar_PQ = Zbar(xf, P,Q)
  # % Zak transform FD
  # Zbar_PQ = ifft(V(xf,P,Q));
  # end
  call "V.gvi"(P=$K, Q=$M, x=$x) -> (Vx=w1)
  call "ColumnwiseFFT.gvi"(X=w1, Inverse?=TRUE, error in=$"error in") -> (Error=w2, Xf=w3)
  $Z_KM <- w3
  $"error out" <- w2
