vi "iV.gvi"   [LabVIEW Communications System Design Suite 2.0.1]
inputs:
  "Vx": c128[][]
outputs:
  "x": c128[]
diagram:
  # function x = iV(Vx)
  # Vx = Vx.';
  # x = Vx(:);
  # end
  Array Size(array=$Vx) -> (size(s)=w1)
  Array Index(array=w1) -> (out0[_]=w2, out1[_]=w3)
  Multiply(w2, w3) -> w4
  Reshape Array(inArray=$Vx, size=w4) -> w5
  $x <- w5
