vi "iZ.gvi"   [LabVIEW Communications System Design Suite 2.0.1]
inputs:
  "Z_MK": c128[][]
  "error in": error
outputs:
  "x": c128[]
  "error out": error
diagram:
  # function x = iZ(Z_QP)
  # % inverse Zak transform TD
  # x = iV(ifft(Z_QP));
  # end
  call "ColumnwiseFFT.gvi"(X=$Z_MK, Inverse?=TRUE, error in=$"error in") -> (Error=w1, Xf=w2)
  call "iV.gvi"(Vx=w2) -> (x=w3)
  $x <- w3
  $"error out" <- w1
