vi "iZbar.gvi"   [LabVIEW Communications System Design Suite 2.0.1]
inputs:
  "Z_KM": c128[][]
  "error in": error
outputs:
  "x": c128[]
  "error out": error
diagram:
  # % inverse ZAK FD
  # function xf = iZbar(Z_PQ)
  # % inverse Zak transform FD
  # xf = iV(fft(Z_PQ));
  # end
  call "ColumnwiseFFT.gvi"(X=$Z_KM, Inverse?=FALSE, error in=$"error in") -> (Error=w1, Xf=w2)
  call "iV.gvi"(Vx=w2) -> (x=w3)
  $x <- w3
  $"error out" <- w1
