vi "Conv_Demod_TD.gvi"   [LabVIEW Communications System Design Suite 2.0.1]
inputs:
  "y": c128[]
  "Demodulator config": "Modem config.gtype"
  "gbr": c128[]
  "error in": error
outputs:
  "Error out": error
  "D": c128[][]
types:
  "Domain.gtype" = enum{"TD", "FD"}
  "Modem config.gtype" = cluster{"Domain": "Domain.gtype", "Window": c128[][], "Enable Window": bool, "Enable Transform": bool, "enable K-spread": bool, "enable M-spread": bool, "K": i32, "M": i32}
diagram:
  Property Node(instance in=$"Demodulator config") -> ("M"=w1, "K"=w2)
  call "V.gvi"(P=w1, Q=w2, x=$y) -> (Vx=w3)
  Transpose 2D Array(2D array=w3) -> (transposed array=w4)
  # function D = Conv_TD_Demod(y,gbr,K,M)
  #         % gbr = \gamma[-n]^* % demodulator pulse
  #         Gamm = cell(M,1);
  #         Yb = cell(M,1);
  #         % reshape received signal
  #         Vy = reshape(y,K,M);
  #         % reshape pulse
  #         Vgr = reshape(gbr,K,M);
  #         p = 0:M-1;
  #         % build matrix G^{m}
  #         for m=0:M-1
  #             %Gamm{m}(q,p) = vgr (<p-m>_M,q);
  #             Gamm{m+1} = Vgr(:, mod(p-m,M)+1);
  #             % \bar{D}^{m}
  #             Yb{m+1} = repmat(Vy(:,m+1),1,M);
  #         end
  #         X = zeros(K,M);
  #         for m = 1:M
  #             X = X+ Gamm{m}.*Yb{m};
  #         end
  #         if K > 1
  #             D = fft(X);
  #         else
  #             D = X;
  #         end
  #     end
  # w2: K
  # w1: M
  call "V.gvi"(P=w1, Q=w2, x=$gbr) -> (Vx=w5)
  Transpose 2D Array(2D array=w5) -> (transposed array=w6)
  # Initialize
  Initialize Array(element=0, size=w2, size=w1) -> w7
  # Note that auto indexing is feeding rows
  #
  # Constructing array is done by stacking the rows
  s1 = w7  # shift register
  for (N = w1) (iteration -> i1) {
    # Circuilar pulse
    for {
      w8 = each element of w6
      Rotate 1D Array(array=w8, n=i1) -> (array (last n elements first)=w10)
      append w10 to w9
    }
    Array Index(array=w4) -> (out0[_, i1]=w11)
    # Repeat Df
    s2 = c128[][] []  # shift register
    for (N = w1) {
      Build Array[ConcatenateInputs=True](w11, s2) -> w12
      next s2 = w12
    }
    # Sum
    Transpose 2D Array(2D array=s2) -> (transposed array=w13)
    # Product
    Multiply(w9, w13) -> w14
    Add(w14, s1) -> w15
    next s1 = w15
  }
  call "ColumnwiseFFT.gvi"(X=s1, Inverse?=FALSE, error in=$"error in") -> (Error=w16, Xf=w17)
  $D <- w17
  $"Error out" <- w16
