vi "Conv_Mod_TD.gvi"   [LabVIEW Communications System Design Suite 2.0.1]
inputs:
  "D": c128[][]
  "g": c128[]
  "error in": error
  "Modulator config": "Modem config.gtype"
outputs:
  "x": c128[]
  "Error out": error
types:
  "Domain.gtype" = enum{"TD", "FD"}
  "Modem config.gtype" = cluster{"Domain": "Domain.gtype", "Window": c128[][], "Enable Window": bool, "Enable Transform": bool, "enable K-spread": bool, "enable M-spread": bool, "K": i32, "M": i32}
diagram:
  Property Node(instance in=$"Modulator config") -> ("K"=w1, "M"=w2)
  # function x = Conv_TD_Mod(D,g,K,M)
  # % 1/KF_K^H*D
  # if K > 1
  #     Df = ifft(D);
  # else
  #     Df = D;
  # end
  # G = cell(M,1);
  # Db = cell(M,1);
  # % V_MK_g^T
  # Vgt = K*reshape(g,K,M);
  # p = 0:M-1;
  # % build matrix G^{m}
  # for m=0:M-1
  #     %G{m}(q,p) = vg (<p-m>_M,q);
  #     G{m+1} = Vgt(:, mod(p-m,M)+1);
  #     % \bar{D}^{m}
  #     Db{m+1} = repmat(Df(:,m+1),1,M);
  # end
  # X = zeros(K,M);
  # for m = 1:M
  #     X = X+ G{m}.*Db{m};
  # end
  # x = X(:);
  # end
  call "ColumnwiseFFT.gvi"(X=$D, Inverse?=TRUE, error in=$"error in") -> (Error=w3, Xf=w4)
  # w1: K
  Multiply($g, w1) -> w5
  # w2: M
  call "V.gvi"(P=w2, Q=w1, x=w5) -> (Vx=w6)
  Transpose 2D Array(2D array=w6) -> (transposed array=w7)
  Initialize Array(element=0, size=w1, size=w2) -> w8
  # w4: Df
  # init Output
  s1 = w8  # shift register
  for (N = w2) (iteration -> i1) {
    # Circuilar pulse
    for {
      w9 = each element of w7
      Rotate 1D Array(array=w9, n=i1) -> (array (last n elements first)=w11)
      append w11 to w10
    }
    Array Index(array=w4) -> (out0[_, i1]=w12)
    # i1: m index
    # Repeat columns of Df M times
    s2 = c128[][] []  # shift register
    for (N = w2) {
      Build Array[ConcatenateInputs=True](w12, s2) -> w13
      next s2 = w13
    }
    Transpose 2D Array(2D array=s2) -> (transposed array=w14)
    # Product
    Multiply(w10, w14) -> w15
    # Sum
    Add(w15, s1) -> w16
    next s1 = w16
  }
  $"Error out" <- w3
  Transpose 2D Array(2D array=s1) -> (transposed array=w17)
  # Vectorization
  call "iV.gvi"(Vx=w17) -> (x=w18)
  $x <- w18
