vi "Demodulator.gvi"   [LabVIEW Communications System Design Suite 2.0.1]
inputs:
  "x": c128[]
  "error in": error
  "Demodulator config": "Modem config.gtype"
outputs:
  "D": c128[][]
  "Error out": error
types:
  "Domain.gtype" = enum{"TD", "FD"}
  "Modem config.gtype" = cluster{"Domain": "Domain.gtype", "Window": c128[][], "Enable Window": bool, "Enable Transform": bool, "enable K-spread": bool, "enable M-spread": bool, "K": i32, "M": i32}
diagram:
  Property Node(instance in=$"Demodulator config") -> ("Domain"=w1, "K"=w2, "M"=w3)
  call "Deallocation.gvi"(Domain=w1, x=$x, Error in=$"error in", K=w2, M=w3) -> (Vx=w4, Error out=w5)
  Property Node(instance in=$"Demodulator config") -> ("Domain"=w6, "Enable Transform"=w7)
  call "Detransform.gvi"(Vy=w4, Domain=w6, Enable T=w7, error in=w5) -> (Error out=w8, Y=w9)
  Property Node(instance in=$"Demodulator config") -> ("Window"=w10, "Enable Window"=w11)
  call "Windowing.gvi"(X=w9, W=w10, Enable W=w11, Error in=w8) -> (XW=w12, Error out=w13)
  Property Node(instance in=$"Demodulator config") -> ("enable K-spread"=w14, "enable M-spread"=w15)
  call "Despreading.gvi"(Ds=w12, enable M=w15, enable K=w14, error in=w13) -> (D=w16, Error out=w17)
  $D <- w16
  $"Error out" <- w17
