vi "Despreading.gvi"   [LabVIEW Communications System Design Suite 2.0.1]
inputs:
  "Ds": c128[][]
  "enable M": bool
  "enable K": bool
  "error in": error
outputs:
  "D": c128[][]
  "Error out": error
diagram:
  case ($"enable M") {
    frame False, Default {
      w1 = $"error in"
      w2 = $Ds
    }
    frame True {
      Transpose 2D Array(2D array=$Ds) -> (transposed array=w3)
      call "ColumnwiseFFT.gvi"(X=w3, Inverse?=TRUE, error in=$"error in") -> (Error=w1, Xf=w4)
      Transpose 2D Array(2D array=w4) -> (transposed array=w2)
    }
  }
  # function D = Despreading(Ds)
  # [K,M] = size(Ds);
  # if  K>1
  #     D = fft(Ds);
  # else
  #     D = Ds;
  # end
  #
  # if M>1
  #     D = transpose(ifft(transpose(D)));
  # end
  # end
  case ($"enable K") {
    frame False, Default {
      w5 = w2
      w6 = w1
    }
    frame True {
      call "ColumnwiseFFT.gvi"(X=w2, Inverse?=FALSE, error in=w1) -> (Error=w6, Xf=w5)
    }
  }
  $D <- w5
  $"Error out" <- w6
