vi "Detransform.gvi"   [LabVIEW Communications System Design Suite 2.0.1]
inputs:
  "Vy": c128[][]
  "Domain": "Domain.gtype" = "TD"
  "Enable T": bool
  "error in": error
outputs:
  "Error out": error
  "Y": c128[][]
types:
  "Domain.gtype" = enum{"TD", "FD"}
diagram:
  # function Y = Detransform(Vy, dom)
  # %2 detransform(D,dom);
  # if strcmp(dom,'TD')
  #     % Vy: MxK
  #     M = size(Vy,1);
  #     % Y = (F_M Vy).'
  #     if  M>1
  #         Y = transpose(fft(Vy));
  #     else
  #         Y = transpose(Vy);
  #     end
  # else % FD
  #     % Vy: KxM
  #     % Y = 1/K*F_K^H Vy
  #       K = size(Vy,1);
  #     if K>1
  #         Y = ifft(Vy);
  #     else
  #         Y = Vy;
  #     end
  # end
  # end
  case ($"Enable T") {
    frame False, Default {
      case ($Domain) {
        frame "TD", Default {
          Transpose 2D Array(2D array=$Vy) -> (transposed array=w2)
        }
        frame "FD" {
          w2 = $Vy
        }
      }
      w1 = $"error in"
    }
    frame True {
      case ($Domain) {
        frame "TD", Default {
          call "ColumnwiseFFT.gvi"(X=$Vy, Inverse?=FALSE, error in=$"error in") -> (Error=w1, Xf=w3)
          Transpose 2D Array(2D array=w3) -> (transposed array=w2)
        }
        frame "FD" {
          call "ColumnwiseFFT.gvi"(X=$Vy, Inverse?=TRUE, error in=$"error in") -> (Error=w1, Xf=w2)
        }
      }
    }
  }
  $Y <- w2
  $"Error out" <- w1
