vi "Spreading.gvi"   [LabVIEW Communications System Design Suite 2.0.1]
inputs:
  "D": c128[][]
  "enable M": bool
  "enable K": bool
  "error in": error
outputs:
  "Error out": error
  "Ds": c128[][]
diagram:
  case ($"enable M") {
    frame False, Default {
      w1 = $"error in"
      w2 = $D
    }
    frame True {
      Transpose 2D Array(2D array=$D) -> (transposed array=w3)
      call "ColumnwiseFFT.gvi"(X=w3, Inverse?=FALSE, error in=$"error in") -> (Error=w1, Xf=w4)
      Transpose 2D Array(2D array=w4) -> (transposed array=w2)
    }
  }
  # function Ds = Spreading(D)
  # [K, M] = size(D);
  # if  M> 1
  #     Ds = transpose(fft(transpose(D)));
  # else
  #     Ds = D;
  # end
  # if  K>1
  #     Ds = ifft(Ds);
  # end
  # end
  #
  # %% enable functionality is added as well
  case ($"enable K") {
    frame False, Default {
      w5 = w2
      w6 = w1
    }
    frame True {
      call "ColumnwiseFFT.gvi"(X=w2, Inverse?=TRUE, error in=w1) -> (Error=w6, Xf=w5)
    }
  }
  $Ds <- w5
  $"Error out" <- w6
