vi "Transform.gvi"   [LabVIEW Communications System Design Suite 2.0.1]
inputs:
  "X": c128[][]
  "Domain": "Domain.gtype" = "TD"
  "Enable T": bool
  "error in": error
outputs:
  "Error out": error
  "Vx": c128[][]
types:
  "Domain.gtype" = enum{"TD", "FD"}
diagram:
  # function Vx = Transform(X, dom)
  # [K,M] = size(X);
  # if strcmp(dom,'TD')
  #     if M>1
  #         Vx = ifft(X.');
  #     else
  #         Vx = X.';
  #     end
  # else % FD
  #     if  K>1
  #         % X: KxM
  #         % Vx = F_K X
  #         Vx = fft(X);
  #     else
  #         Vx = X;
  #     end
  # end
  # end
  # % enable is added as well
  case ($"Enable T") {
    frame False, Default {
      case ($Domain) {
        frame "TD", Default {
          Transpose 2D Array(2D array=$X) -> (transposed array=w2)
        }
        frame "FD" {
          w2 = $X
        }
      }
      w1 = $"error in"
    }
    frame True {
      case ($Domain) {
        frame "TD", Default {
          Transpose 2D Array(2D array=$X) -> (transposed array=w3)
          call "ColumnwiseFFT.gvi"(X=w3, Inverse?=TRUE, error in=$"error in") -> (Error=w1, Xf=w2)
        }
        frame "FD" {
          call "ColumnwiseFFT.gvi"(X=$X, Inverse?=FALSE, error in=$"error in") -> (Error=w1, Xf=w2)
        }
      }
    }
  }
  $Vx <- w2
  $"Error out" <- w1
