vi "Modulator.gvi"   [LabVIEW Communications System Design Suite 2.0.1]
inputs:
  "D": c128[][]
  "error in": error
  "Modulator config": "Modem config.gtype"
outputs:
  "Error out": error
  "x": c128[]
types:
  "Domain.gtype" = enum{"TD", "FD"}
  "Modem config.gtype" = cluster{"Domain": "Domain.gtype", "Window": c128[][], "Enable Window": bool, "Enable Transform": bool, "enable K-spread": bool, "enable M-spread": bool, "K": i32, "M": i32}
diagram:
  Property Node(instance in=$"Modulator config") -> ("Window"=w1, "Enable Window"=w2)
  Property Node(instance in=$"Modulator config") -> ("enable K-spread"=w3, "enable M-spread"=w4)
  call "Spreading.gvi"(D=$D, enable M=w4, enable K=w3, error in=$"error in") -> (Error out=w5, Ds=w6)
  call "Windowing.gvi"(X=w6, W=w1, Enable W=w2, Error in=w5) -> (XW=w7, Error out=w8)
  Property Node(instance in=$"Modulator config") -> ("Domain"=w9, "Enable Transform"=w10)
  call "Transform.gvi"(X=w7, Domain=w9, Enable T=w10, error in=w8) -> (Error out=w11, Vx=w12)
  call "Allocation.gvi"(Vx=w12, Error in=w11) -> (Error out=w13, x=w14)
  $x <- w14
  $"Error out" <- w13
