vi "Ref_Demod.gvi"   [LabVIEW Communications System Design Suite 2.0.1]
inputs:
  "x": c128[]
  "Deodulator config": "Modem config.gtype"
  "error in": error
  "gr": c128[]
outputs:
  "error out": error
  "D": c128[][]
types:
  "Domain.gtype" = enum{"TD", "FD"}
  "Modem config.gtype" = cluster{"Domain": "Domain.gtype", "Window": c128[][], "Enable Window": bool, "Enable Transform": bool, "enable K-spread": bool, "enable M-spread": bool, "K": i32, "M": i32}
diagram:
  Property Node(instance in=$"Deodulator config") -> ("K"=w1, "M"=w2, "Domain"=w3)
  Math Node("K"=w1, "M"=w2, "dom"=w3, "gr"=$gr, "x"=$x, Error In=$"error in") -> ("D"=w4, Error Out=w5)
  ~~~
     % refrence equatin
          K = double(K);
          M = double(M);
            N = M*K;
             D  = zeros(K,M);
  TD = dom == 0;
  for m=0:M-1
      for k=0:K-1
          % Note that N_cp can be included here
          for n=0:N-1
              if TD
                  D(k+1,m+1) = D(k+1,m+1) + x(n+1)* conj(gr(mod(n-m*K,N)+1))*exp(-2*1j*pi*n*k/K);
              else
                  D(k+1,m+1) = D(k+1,m+1) + x(n+1)* conj(gr(mod(n-k*M,N)+1))*exp(2*1j*pi*n*m/M);
              end
          end
      end
  end
  ~~~
  $"error out" <- w5
  $D <- w4
