vi "Ref_Mod.gvi"   [LabVIEW Communications System Design Suite 2.0.1]
inputs:
  "D": c128[][]
  "Modulator config": "Modem config.gtype"
  "error in": error
  "g": c128[]
outputs:
  "x": c128[]
  "error out": error
types:
  "Domain.gtype" = enum{"TD", "FD"}
  "Modem config.gtype" = cluster{"Domain": "Domain.gtype", "Window": c128[][], "Enable Window": bool, "Enable Transform": bool, "enable K-spread": bool, "enable M-spread": bool, "K": i32, "M": i32}
diagram:
  Property Node(instance in=$"Modulator config") -> ("K"=w1, "M"=w2, "Domain"=w3)
  Math Node("K"=w1, "M"=w2, "dom"=w3, "g"=$g, "D"=$D, Error In=$"error in") -> ("x"=w4, Error Out=w5)
  ~~~
     % refrence equatin
          TD = (dom == 0);
          K = double(K);
          M = double(M);
            N = M*K;
              tmp = zeros(N,1);
          x  = zeros(N,1);
          for m=0:M-1
              for k=0:K-1
                  % Note that N_cp can be included here
                  for n=0:N-1
                      if TD
                          tmp(n+1) = D(k+1,m+1) * g(mod(n-m*K, N)+1)*exp(2*1j*pi*n*k/K);
                      else
                          tmp(n+1) = D(k+1,m+1) * g(mod(n-k*M, N)+1)*exp(-2*1j*pi*n*m/M);
                      end
                  end
                  x = x+ tmp;
              end
          end
  ~~~
  $"error out" <- w5
  $x <- w4
