vi "Test_All_Modems.gvi"   [LabVIEW Communications System Design Suite 2.0.1]
panel controls:
  "Modem config": "Modem config.gtype"
panel indicators:
  "Error out": error
  "NMSE": f64
  "TD conv Mod vs $steps": f64
  "TD conv Modem": f64
  "NMSE Ref": f64
  "NMSE Ref vs 4 steps": f64
types:
  "Domain.gtype" = enum{"TD", "FD"}
  "Modem config.gtype" = cluster{"Domain": "Domain.gtype", "Window": c128[][], "Enable Window": bool, "Enable Transform": bool, "enable K-spread": bool, "enable M-spread": bool, "K": i32, "M": i32}
diagram:
  Property Node(instance in=$"Modem config") -> ("K"=w1, "M"=w2)
  # w3: D
  Multiply(w1, w2) -> w4
  call "Gen_rand_mat.gvi"(K=w1, M=w2) -> (X=w5)
  call "Wtx2Wrx.gvi"(Wtx=w5, 1/snr=1, rxType="ZF", Error in=no error) -> (Wrx=w6, Error out=w7)
  Property Node(instance in=$"Modem config", "Window"=w6) -> ("Domain"=w8, instance out=w9)
  Property Node(instance in=w9) -> ("Window"=w10)
  call "Wrx2gammabTD.gvi"(Wrx=w10) -> (gammab=w11)
  call "Gen_rand_mat.gvi"(K=w1, M=w2) -> (X=w3)
  call "Wtx2g.gvi"(Wtx=w5, Domain="TD") -> (g=w12)
  call "Conv_Mod_TD.gvi"(D=w3, g=w12, Modulator config=w9) -> (x=w13)
  call "Conv_Demod_TD.gvi"(y=w13, Demodulator config=w9, gbr=w11) -> (D=w14)
  Reshape Array(inArray=w14, size=w4) -> w15
  Reshape Array(inArray=w3, size=w4) -> w16
  call "NMSE.gvi"(x1=w15, x2=w16) -> (NMSE=w17)
  $"TD conv Modem" <- w17
  # w5: Wtx
  Property Node(instance in=$"Modem config", "Window"=w5) -> (instance out=w18)
  call "Modulator.gvi"(D=w3, error in=w7, Modulator config=w18) -> (Error out=w19, x=w20)
  call "NMSE.gvi"(x1=w13, x2=w20) -> (NMSE=w21)
  $"TD conv Mod vs $steps" <- w21
  call "Demodulator.gvi"(x=w20, error in=w19, Demodulator config=w9) -> (D=w22, Error out=w23)
  Reshape Array(inArray=w22, size=w4) -> w24
  call "NMSE.gvi"(x1=w16, x2=w24) -> (NMSE=w25)
  $NMSE <- w25
  $"Error out" <- w23
  Reshape Array(inArray=w3, size=w4) -> w26
  call "Wrx2gamma.gvi"(Wrx=w6, Domain=w8) -> (gamma=w27)
  call "Wtx2g.gvi"(Wtx=w5, Domain=w8) -> (g=w28)
  call "Ref_Mod.gvi"(D=w3, Modulator config=w18, g=w28) -> (x=w29, error out=w30)
  call "Ref_Demod.gvi"(x=w29, Deodulator config=w9, error in=w30, gr=w27) -> (D=w31)
  Reshape Array(inArray=w31, size=w4) -> w32
  call "NMSE.gvi"(x1=w26, x2=w32) -> (NMSE=w33)
  $"NMSE Ref" <- w33
  call "NMSE.gvi"(x1=w20, x2=w29) -> (NMSE=w34)
  $"NMSE Ref vs 4 steps" <- w34
