vi "Test_Conv_Modem.gvi"   [LabVIEW Communications System Design Suite 2.0.1]
panel controls:
  "Modem config": "Modem config.gtype" = {"Domain"="TD", "K"=13, "M"=2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}
  "rxType": "rxType.gtype" = "ZF"
  "PulseParams": "PulseParams.gtype" = {"PulseType"="RC", "K"=13, "M"=2, "achirp"=0, "alpha"=0}
panel indicators:
  "NMSE": f64
  "Error out": error
types:
  "Domain.gtype" = enum{"TD", "FD"}
  "Modem config.gtype" = cluster{"Domain": "Domain.gtype", "Window": c128[][], "Enable Window": bool, "Enable Transform": bool, "enable K-spread": bool, "enable M-spread": bool, "K": i32, "M": i32}
  "rxType.gtype" = enum{"ZF", "MF", "MMSE"}
  "PulseType.gtype" = enum{"RC", "Rect", "Chirp", "Random", ""}
  "PulseParams.gtype" = cluster{"PulseType": "PulseType.gtype", "K": i32, "M": i32, "achirp": f64, "alpha": f64}
diagram:
  Property Node(instance in=$"Modem config", "Domain"="TD") -> ("K"=w1, "M"=w2, instance out=w3)
  Property Node(instance in=$PulseParams, "K"=w1, "M"=w2) -> (instance out=w4)
  $PulseParams <- w4
  call "Gen_rand_mat.gvi"(K=w1, M=w2) -> (X=w5)
  call "PulseGeneration.gvi"(PulseParams=w4) -> (gt=w6)
  Property Node(instance in=w3) -> ("K"=w7, "M"=w8, "Domain"=w9)
  call "g2Wtx.gvi"(pulse=w6, K=w7, M=w8, Domain=w9) -> (Wtx=w10)
  call "Wtx2Wrx.gvi"(Wtx=w10, 1/snr=0, rxType=$rxType) -> (Wrx=w11)
  call "Wrx2gammabTD.gvi"(Wrx=w11) -> (gammab=w12)
  call "Conv_Mod_TD.gvi"(D=w5, g=w6, Modulator config=w3) -> (x=w13)
  call "Conv_Demod_TD.gvi"(y=w13, Demodulator config=w3, gbr=w12) -> (Error out=w14, D=w15)
  call "NMSE_2D.gvi"(X1=w5, X2=w15) -> (NMSE=w16)
  $NMSE <- w16
  $"Error out" <- w14
