vi "Test_Modem.gvi"   [LabVIEW Communications System Design Suite 2.0.1]
panel controls:
  "Modem config": "Modem config.gtype"
  "rxType": "rxType.gtype" = "ZF"
  "PulseParams": "PulseParams.gtype"
panel indicators:
  "NMSE": f64
  "Error out": error
types:
  "Domain.gtype" = enum{"TD", "FD"}
  "Modem config.gtype" = cluster{"Domain": "Domain.gtype", "Window": c128[][], "Enable Window": bool, "Enable Transform": bool, "enable K-spread": bool, "enable M-spread": bool, "K": i32, "M": i32}
  "rxType.gtype" = enum{"ZF", "MF", "MMSE"}
  "PulseType.gtype" = enum{"RC", "Rect", "Chirp", "Random", ""}
  "PulseParams.gtype" = cluster{"PulseType": "PulseType.gtype", "K": i32, "M": i32, "achirp": f64, "alpha": f64}
diagram:
  Property Node(instance in=$"Modem config") -> ("K"=w1, "M"=w2, "Domain"=w3)
  Property Node(instance in=$PulseParams, "K"=w1, "M"=w2) -> (instance out=w4)
  $PulseParams <- w4
  call "Gen_rand_mat.gvi"(K=w1, M=w2) -> (X=w5)
  call "PulseGeneration.gvi"(PulseParams=w4) -> (gf=w6, gt=w7)
  case (w3) {
    frame "FD" {
      w8 = w6
    }
    frame "TD", Default {
      w8 = w7
    }
  }
  Property Node(instance in=$"Modem config") -> ("K"=w9, "M"=w10, "Domain"=w11)
  call "g2Wtx.gvi"(pulse=w8, K=w9, M=w10, Domain=w11) -> (Wtx=w12)
  Property Node(instance in=$"Modem config", "Window"=w12) -> (instance out=w13)
  call "Modulator.gvi"(D=w5, Modulator config=w13) -> (Error out=w14, x=w15)
  call "Wtx2Wrx.gvi"(Wtx=w12, 1/snr=0, rxType=$rxType) -> (Wrx=w16)
  Property Node(instance in=$"Modem config", "Window"=w16) -> (instance out=w17)
  call "Demodulator.gvi"(x=w15, error in=w14, Demodulator config=w17) -> (D=w18, Error out=w19)
  call "NMSE_2D.gvi"(X1=w5, X2=w18) -> (NMSE=w20)
  $NMSE <- w20
  $"Error out" <- w19
