vi "Test_Ref_Modem.gvi"   [LabVIEW Communications System Design Suite 2.0.1]
panel controls:
  "Modem config": "Modem config.gtype" = {"Domain"="TD", "K"=10, "M"=10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}
  "rxType": "rxType.gtype" = "ZF"
  "PulseParams": "PulseParams.gtype" = {"PulseType"="RC", "K"=10, "M"=10, "achirp"=0, "alpha"=0}
panel indicators:
  "TD conv Modem": f64
types:
  "Domain.gtype" = enum{"TD", "FD"}
  "Modem config.gtype" = cluster{"Domain": "Domain.gtype", "Window": c128[][], "Enable Window": bool, "Enable Transform": bool, "enable K-spread": bool, "enable M-spread": bool, "K": i32, "M": i32}
  "rxType.gtype" = enum{"ZF", "MF", "MMSE"}
  "PulseType.gtype" = enum{"RC", "Rect", "Chirp", "Random", ""}
  "PulseParams.gtype" = cluster{"PulseType": "PulseType.gtype", "K": i32, "M": i32, "achirp": f64, "alpha": f64}
diagram:
  Property Node(instance in=$"Modem config") -> ("K"=w1, "M"=w2, "Domain"=w3)
  call "Gen_rand_mat.gvi"(K=w1, M=w2) -> (X=w4)
  Property Node(instance in=$PulseParams, "K"=w1, "M"=w2) -> (instance out=w5)
  call "PulseGeneration.gvi"(PulseParams=w5) -> (gf=w6, gt=w7)
  case (w3) {
    frame "FD" {
      w8 = w6
    }
    frame "TD", Default {
      w8 = w7
    }
  }
  call "RxPulse.gvi"(Modem config=$"Modem config", g=w8, rxType=$rxType) -> (gr=w9, error out=w10)
  call "Ref_Mod.gvi"(D=w4, Modulator config=$"Modem config", error in=w10, g=w8) -> (x=w11, error out=w12)
  call "Ref_Demod.gvi"(x=w11, Deodulator config=$"Modem config", error in=w12, gr=w9) -> (D=w13)
  call "NMSE_2D.gvi"(X1=w4, X2=w13) -> (NMSE=w14)
  $"TD conv Modem" <- w14
  $PulseParams <- w5
