vi "Test_Spreading.gvi"   [LabVIEW Communications System Design Suite 2.0.1]
panel controls:
  "K": i32 = 3
  "M": i32 = 5
  "enable K": bool = TRUE
  "enable M": bool = TRUE
panel indicators:
  "Error out": error
  "NMSE": f64
diagram:
  call "Gen_rand_mat.gvi"(K=$K, M=$M) -> (X=w1)
  call "Spreading.gvi"(D=w1, enable M=$"enable M", enable K=$"enable K", error in=no error) -> (Error out=w2, Ds=w3)
  call "Despreading.gvi"(Ds=w3, enable M=$"enable M", enable K=$"enable K", error in=w2) -> (D=w4, Error out=w5)
  call "NMSE_2D.gvi"(X1=w4, X2=w1) -> (NMSE=w6)
  $NMSE <- w6
  $"Error out" <- w5
