vi "Test_Transform.gvi"   [LabVIEW Communications System Design Suite 2.0.1]
panel controls:
  "K": i32 = 9
  "M": i32 = 9
  "enable T": bool = TRUE
  "Domain": "Domain.gtype" = "TD"
panel indicators:
  "Error out": error
  "NMSE": f64
types:
  "Domain.gtype" = enum{"TD", "FD"}
diagram:
  call "Gen_rand_mat.gvi"(K=$K, M=$M) -> (X=w1)
  call "Transform.gvi"(X=w1, Domain=$Domain, Enable T=$"enable T", error in=no error) -> (Error out=w2, Vx=w3)
  call "Detransform.gvi"(Vy=w3, Domain=$Domain, Enable T=$"enable T", error in=w2) -> (Error out=w4, Y=w5)
  call "NMSE_2D.gvi"(X1=w5, X2=w1) -> (NMSE=w6)
  $NMSE <- w6
  $"Error out" <- w4
