vi "Text_Conv_Mod_Vs_Ref_Mod.gvi"   [LabVIEW Communications System Design Suite 2.0.1]
panel controls:
  "Modem config": "Modem config.gtype"
  "PulseParams": "PulseParams.gtype"
panel indicators:
  "NMSE": f64
types:
  "Domain.gtype" = enum{"TD", "FD"}
  "Modem config.gtype" = cluster{"Domain": "Domain.gtype", "Window": c128[][], "Enable Window": bool, "Enable Transform": bool, "enable K-spread": bool, "enable M-spread": bool, "K": i32, "M": i32}
  "PulseType.gtype" = enum{"RC", "Rect", "Chirp", "Random", ""}
  "PulseParams.gtype" = cluster{"PulseType": "PulseType.gtype", "K": i32, "M": i32, "achirp": f64, "alpha": f64}
diagram:
  Property Node(instance in=$"Modem config", "Domain"="TD") -> ("K"=w1, "M"=w2, instance out=w3)
  $"Modem config" <- w3
  call "Gen_rand_mat.gvi"(K=w1, M=w2) -> (X=w4)
  Property Node(instance in=$PulseParams, "K"=w1, "M"=w2) -> (instance out=w5)
  call "PulseGeneration.gvi"(PulseParams=w5) -> (gt=w6)
  call "Ref_Mod.gvi"(D=w4, Modulator config=w3, g=w6) -> (x=w7)
  call "Conv_Mod_TD.gvi"(D=w4, g=w6, Modulator config=w3) -> (x=w8)
  call "NMSE.gvi"(x1=w7, x2=w8) -> (NMSE=w9)
  $NMSE <- w9
  $PulseParams <- w5
