vi "Text_Modulator_Vs_Ref_Modulator.gvi"   [LabVIEW Communications System Design Suite 2.0.1]
panel controls:
  "Modem config": "Modem config.gtype"
  "PulseParams": "PulseParams.gtype"
panel indicators:
  "NMSE": f64
types:
  "Domain.gtype" = enum{"TD", "FD"}
  "Modem config.gtype" = cluster{"Domain": "Domain.gtype", "Window": c128[][], "Enable Window": bool, "Enable Transform": bool, "enable K-spread": bool, "enable M-spread": bool, "K": i32, "M": i32}
  "PulseType.gtype" = enum{"RC", "Rect", "Chirp", "Random", ""}
  "PulseParams.gtype" = cluster{"PulseType": "PulseType.gtype", "K": i32, "M": i32, "achirp": f64, "alpha": f64}
diagram:
  Property Node(instance in=$"Modem config") -> ("K"=w1, "M"=w2, "Domain"=w3)
  call "Gen_rand_mat.gvi"(K=w1, M=w2) -> (X=w4)
  Property Node(instance in=$PulseParams, "K"=w1, "M"=w2) -> (instance out=w5)
  call "PulseGeneration.gvi"(PulseParams=w5) -> (gf=w6, gt=w7)
  case (w3) {
    frame "FD" {
      w8 = w6
    }
    frame "TD", Default {
      w8 = w7
    }
  }
  call "Ref_Mod.gvi"(D=w4, Modulator config=$"Modem config", g=w8) -> (x=w9)
  Property Node(instance in=w5) -> ("K"=w10, "M"=w11)
  call "g2Wtx.gvi"(pulse=w8, K=w10, M=w11, Domain=w3) -> (Wtx=w12)
  Property Node(instance in=$"Modem config", "Window"=w12) -> (instance out=w13)
  call "Modulator.gvi"(D=w4, Modulator config=w13) -> (x=w14)
  call "NMSE.gvi"(x1=w9, x2=w14) -> (NMSE=w15)
  $NMSE <- w15
  $PulseParams <- w5
