vi "PulseGeneration.gvi"   [LabVIEW Communications System Design Suite 2.0.1]
inputs:
  "PulseParams": "PulseParams.gtype"
  "error in": error
outputs:
  "gf": c128[]
  "gt": c128[]
  "error out": error
types:
  "PulseType.gtype" = enum{"RC", "Rect", "Chirp", "Random", ""}
  "PulseParams.gtype" = cluster{"PulseType": "PulseType.gtype", "K": i32, "M": i32, "achirp": f64, "alpha": f64}
diagram:
  Property Node(instance in=$PulseParams) -> ("K"=w1, "M"=w2, "alpha"=w3, "achirp"=w4, "PulseType"=w5)
  Math Node("K"=w1, "M"=w2, "alpha"=w3, "achirp"=w4, "type"=w5, Error In=$"error in") -> ("g_f"=w6, "g_t"=w7, Error Out=w8)
  ~~~
  K = double(K);
  M = double(M);
  N = K*M;
   g_t = zeros(N,1);
  switch type
  case 0
  %alpha;
  if mod(M,2)== 0
      shift = 0.5;
  else
      shift = 0;
  end
  f=(-1/2:1/N: (1/2-1/N))'+shift/N;
  g_f = zeros(length(f),1);
  ind = abs(f)<= (1-alpha)/(2*K);
  g_f(ind) = 1;
  ind = ((abs(f)> (1-alpha)/(2*K))& (abs(f) <= (1+alpha)/(2*K)));
  f1 = f(ind);
      g_f(ind)= 1/2*(1+sin(-pi*K/alpha*(abs(f1)-1/(2*K))));
  g_f = sqrt(N)*g_f/norm(g_f);
  g_f = fftshift(g_f);
  g_t = ifft(g_f);
  g_t = g_t/norm(g_t);
  g_f = g_f/norm(g_t);
  case 1
   g_t(1:K) = ones(K,1);
  case 2
  g_t(1:K) = ones(K,1);
  g_t(1:K) = ones(K,1).*exp(1j*2*pi*(0:K-1)'.^2*achirp);

  otherwise
  g_t = randn(N,1)+1j*randn(N,1);
  end
  g_t = g_t/norm(g_t);
   g_f = fft(g_t);
  ~~~
  $"error out" <- w8
  $gf <- w6
  $gt <- w7
