vi "RxPulse.gvi"   [LabVIEW Communications System Design Suite 2.0.1]
inputs:
  "Modem config": "Modem config.gtype"
  "g": c128[]
  "rxType": "rxType.gtype" = "ZF"
  "1/snr": f64
  "error in": error
outputs:
  "gr": c128[]
  "error out": error
types:
  "rxType.gtype" = enum{"ZF", "MF", "MMSE"}
  "Domain.gtype" = enum{"TD", "FD"}
  "Modem config.gtype" = cluster{"Domain": "Domain.gtype", "Window": c128[][], "Enable Window": bool, "Enable Transform": bool, "enable K-spread": bool, "enable M-spread": bool, "K": i32, "M": i32}
diagram:
  Property Node(instance in=$"Modem config") -> ("K"=w1, "M"=w2, "Domain"=w3)
  call "g2Wtx.gvi"(pulse=$g, K=w1, M=w2, Domain=w3, error in=$"error in") -> (Wtx=w4, error out=w5)
  call "Wtx2Wrx.gvi"(Wtx=w4, 1/snr=$"1/snr", rxType=$rxType, Error in=w5) -> (Wrx=w6, Error out=w7)
  call "Wrx2gamma.gvi"(Wrx=w6, Domain=w3, error in=w7) -> (error out=w8, gamma=w9)
  $gr <- w9
  $"error out" <- w8
