vi "Test_window.gvi"   [LabVIEW Communications System Design Suite 2.0.1]
panel controls:
  "error in": error
  "error in_2": error
  "stop": bool
  "Update": bool
  "rxType": "rxType.gtype" = "ZF"
  "1/snr": f64
  "PulseParams": "PulseParams.gtype"
panel indicators:
  "Win_NMSE_TD": f64
  "Graph TD": f64[][]
  "error out": error
  "Win_NMSE_FD": f64
  "Graph_FD": f64[][]
  "Graph_FD rx": f64[][]
  "Graph_TD rx": f64[][]
types:
  "rxType.gtype" = enum{"ZF", "MF", "MMSE"}
  "PulseType.gtype" = enum{"RC", "Rect", "Chirp", "Random", ""}
  "PulseParams.gtype" = cluster{"PulseType": "PulseType.gtype", "K": i32, "M": i32, "achirp": f64, "alpha": f64}
diagram:
  w1 = $"error in_2"
  w2 = $"error in"
  while {
    case ($Update) {
      frame False, Default {
        w3 = w1
      }
      frame True {
        $Update <- FALSE
        Property Node(instance in=$PulseParams) -> ("K"=w4, "M"=w5)
        call "PulseGeneration.gvi"(PulseParams=$PulseParams) -> (gf=w6, gt=w7)
        call "g2Wtx.gvi"(pulse=w6, K=w4, M=w5, Domain="FD", error in=w1) -> (Wtx=w8, error out=w9)
        call "Wtx2Wrx.gvi"(Wtx=w8, 1/snr=$"1/snr", rxType=$rxType) -> (Wrx=w10)
        call "Wrx2gamma.gvi"(Wrx=w10, Domain="FD") -> (gamma=w11)
        Complex To Real Imaginary(x + iy=w11) -> (x=w12, y=w13)
        Build Array(w12, w13) -> w14
        $"Graph_FD rx" <- w14
        Complex To Real Imaginary(x + iy=w6) -> (x=w15, y=w16)
        Build Array(w15, w16) -> w17
        $Graph_FD <- w17
        call "Wtx2g.gvi"(Wtx=w8, Domain="FD", error in=w9) -> (error out=w18, g=w19)
        call "NMSE.gvi"(x1=w6, x2=w19) -> (NMSE=w20)
        $Win_NMSE_FD <- w20
        Property Node(instance in=$PulseParams) -> ("K"=w21, "M"=w22)
        call "g2Wtx.gvi"(pulse=w7, K=w21, M=w22, Domain="TD", error in=w2) -> (Wtx=w23, error out=w24)
        call "Wtx2g.gvi"(Wtx=w23, Domain="TD", error in=w24) -> (error out=w25, g=w26)
        Merge Errors(w18, w25) -> (error out=w3)
        Complex To Real Imaginary(x + iy=w7) -> (x=w27, y=w28)
        Build Array(w27, w28) -> w29
        $"Graph TD" <- w29
        call "NMSE.gvi"(x1=w7, x2=w26) -> (NMSE=w30)
        $Win_NMSE_TD <- w30
        call "Wtx2Wrx.gvi"(Wtx=w23, 1/snr=$"1/snr", rxType=$rxType) -> (Wrx=w31)
        call "Wrx2gamma.gvi"(Wrx=w31, Domain="TD") -> (gamma=w32)
        Complex To Real Imaginary(x + iy=w32) -> (x=w33, y=w34)
        Build Array(w33, w34) -> w35
        $"Graph_TD rx" <- w35
      }
    }
    Wait(time to wait=1000)
    stop if $stop
  }
  $"error out" <- w3
