vi "Wrx2gamma.gvi"   [LabVIEW Communications System Design Suite 2.0.1]
inputs:
  "Wrx": c128[][]
  "Domain": "Domain.gtype" = "TD"
  "error in": error
outputs:
  "error out": error
  "gamma": c128[]
types:
  "Domain.gtype" = enum{"TD", "FD"}
uses:
  NI::Analysis::LinearAlgebra::Complex Conjugate Transpose Matrix.gvi
diagram:
  # % pulse from window
  # function g = Wrx2gamma(W, dom)
  # N = numel(W);
  # if strcmp(dom,'TD')
  #     g = iZ(W');
  # else
  #     g = 1/N*iZbar(conj(W));
  # end
  # end
  case ($Domain) {
    frame "FD" {
      Complex Conjugate(x + iy=$Wrx) -> w3
      call "iZbar.gvi"(Z_KM=w3, error in=$"error in") -> (x=w4, error out=w2)
      Array Size(array=w4) -> (size(s)=w5)
      Divide(x=w4, y=w5) -> w1
    }
    frame "TD", Default {
      call "Complex Conjugate Transpose Matrix.gvi"(matrix=$Wrx, error in=$"error in") -> (matrix conjugate transpose=w6, error out=w7)
      call "iZ.gvi"(Z_MK=w6, error in=w7) -> (x=w1, error out=w2)
    }
  }
  $gamma <- w1
  $"error out" <- w2
