vi "Wrx2gammabTD.gvi"   [LabVIEW Communications System Design Suite 2.0.1]
inputs:
  "Wrx": c128[][]
  "error in": error
outputs:
  "error out": error
  "gammab": c128[]
diagram:
  # function g = Wrx2gammabTD(W)
  #     g = iZ(W.');
  # end
  Transpose 2D Array(2D array=$Wrx) -> (transposed array=w1)
  call "iZ.gvi"(Z_MK=w1, error in=$"error in") -> (x=w2, error out=w3)
  $gammab <- w2
  $"error out" <- w3
