vi "Wtx2Wrx.gvi"   [LabVIEW Communications System Design Suite 2.0.1]
inputs:
  "Wtx": c128[][]
  "1/snr": f64
  "rxType": "rxType.gtype" = "ZF"
  "Error in": error
outputs:
  "Wrx": c128[][]
  "Error out": error
types:
  "rxType.gtype" = enum{"ZF", "MF", "MMSE"}
diagram:
  # function wrx = Wtx2Wrx(wtx, rxType, Es, N0)
  # [K,M] = size(wtx);
  # % Generate MMSE receiver window
  #
  # % find MMSE pulse
  # if strcmp(rxType, 'ZF')
  #     % ZF
  #     wrx = 1./wtx;
  # elseif strcmp(rxType, 'MF')
  #     %  MF
  #     wrx = conj(wtx);
  # elseif strcmp(rxType, 'MMSE')
  #     % MMSE
  #     wrx = conj(wtx)./(abs(wtx).^2 + N0*K/Es);
  # end
  # end
  case ($rxType) {
    frame "ZF", Default {
      Reciprocal(x=$Wtx) -> w1
    }
    frame "MF" {
      Complex Conjugate(x + iy=$Wtx) -> w1
    }
    frame "MMSE" {
      Complex Conjugate(x + iy=$Wtx) -> w2
      Multiply(w2, $Wtx) -> w3
      Complex To Real Imaginary(x + iy=w3) -> (x=w4)
      Add(w4, $"1/snr") -> w5
      Reciprocal(x=w5) -> w6
      Multiply(w2, w6) -> w1
    }
  }
  $Wrx <- w1
  $"Error out" <- $"Error in"
