vi "Wtx2g.gvi"   [LabVIEW Communications System Design Suite 2.0.1]
inputs:
  "Wtx": c128[][]
  "Domain": "Domain.gtype" = "TD"
  "error in": error
outputs:
  "error out": error
  "g": c128[]
types:
  "Domain.gtype" = enum{"TD", "FD"}
diagram:
  # function g = Wtx2g(W, dom)
  # K = size(W,2);
  # if strcmp(dom,'TD')
  #     g = 1/K*iZ(W.');
  # else
  #     g = 1/K*iZbar(W);
  # end
  # end
  case ($Domain) {
    frame "FD" {
      call "iZbar.gvi"(Z_KM=$Wtx, error in=$"error in") -> (x=w1, error out=w2)
    }
    frame "TD", Default {
      Transpose 2D Array(2D array=$Wtx) -> (transposed array=w3)
      call "iZ.gvi"(Z_MK=w3, error in=$"error in") -> (x=w1, error out=w2)
    }
  }
  Array Size(array=$Wtx) -> (size(s)=w4)
  Array Index(array=w4) -> (out0[0]=w5)
  Divide(x=w1, y=w5) -> w6
  $g <- w6
  $"error out" <- w2
