vi "g2Wtx.gvi"   [LabVIEW Communications System Design Suite 2.0.1]
inputs:
  "pulse": c128[]
  "K": i32
  "M": i32 = 1
  "Domain": "Domain.gtype" = "TD"
  "error in": error
outputs:
  "Wtx": c128[][]
  "error out": error
types:
  "Domain.gtype" = enum{"TD", "FD"}
diagram:
  # % window from pulse
  # function Wtx = g2Wtx(g,K,M,dom)
  # if strcmp(dom,'TD')
  #     %Wtx_TD = K Z_MK ^T
  #     Wtx = K* Z(g, M,K).';
  # else
  #     %Wtx_FD = K Z_MK
  #     Wtx = K* Zbar(g, K,M);
  # end
  # end
  case ($Domain) {
    frame "TD", Default {
      call "Z.gvi"(x=$pulse, K=$K, M=$M, error in=$"error in") -> (error out=w1, Z_MK=w3)
      Transpose 2D Array(2D array=w3) -> (transposed array=w2)
    }
    frame "FD" {
      call "Zbar.gvi"(x=$pulse, K=$K, M=$M, error in=$"error in") -> (Z_KM=w2, error out=w1)
    }
  }
  To Double Precision Float(number=$K) -> w4
  Multiply(w2, w4) -> w5
  $Wtx <- w5
  $"error out" <- w1
